% Simulink data dictionary ElectricPowertrain_data.sldd

ControllerCmds_BUS = Simulink.Bus()
  ContactorsCmds: Bus: ContactorsCmds_BUS

PhysicalInputs_BUS = Simulink.Bus()
  BServiceDisconnectPos: boolean
  BServiceDisconnectNeg: boolean

rInitialSoC = Simulink.Parameter(repmat(65, 1, 228), DataType="double")
rCellCapacity = Simulink.Parameter(repmat(4, 1, 228), DataType="double")

PlantOutput_BUS = Simulink.Bus()
  VCUKIVT: double
  VESDCLink: double
  VESIVT: double
  BContactorsClosed: boolean

DriverCmds_BUS = Simulink.Bus()
  BStartSwitch: boolean
  BDrive: boolean

ContactorsCmds_BUS = Simulink.Bus()
  BContPosRequested: boolean
  BContNegRequested: boolean
  BPrechargeRequested: boolean
  BActiveDischargeRequested: boolean

BServiceDisconnectPos = Simulink.Parameter(true, DataType="boolean")
tSim = Simulink.Parameter(0.001)
tActiveDischargeDelay = Simulink.Parameter(2)
tCloseContDelay = Simulink.Parameter(0.2)
BServiceDisconnectNeg = Simulink.Parameter(true, DataType="boolean")
BStartSwitch = Simulink.Parameter(false, DataType="boolean")
BDrive = Simulink.Parameter(false, DataType="boolean")

eNPTState = enum(DefaultValue="Off", StorageType="uint8")
  Off = 0  % Powertrain is off
  CloseContactors = 1  % Contactors are requested to close
  TorqueControl = 2  % Motor accepts torque requests
  OpenContactors = 3  % Contactors are requested to open